# Grasshopper definition Twist.ghx (Grasshopper 1.0.8)

# ---- group: Inputs
number_slider = Slider(5, range=0..10)
polizei = Geometry()
axisbase = Point(Point(0, 0, 0))

# ----
geomin = Geometry(<extrusion referenced from the Rhino model>)
Z = UnitZ(Factor=1)
move = Move(Geometry=axisbase, Motion=Z)  # -> Geometry, Transform
rad = Radians(Degrees=number_slider)
ln = Line(StartPoint=axisbase, EndPoint=move.Geometry)
twist = Twist(Geometry=geomin, Axis=ln, Angle=rad, Infinite=True, Rigid=False)

# ---- group: Outputs
num = Number(rad)
geomout = Geometry(twist)
